# Grasshopper definition test.gh (Grasshopper 0.9.76)
# plug-ins: ForceDiagram

srf = Surface([<surface referenced from the Rhino model> x8])
srf_2 = Surface([<surface referenced from the Rhino model> x8])
crv = Curve([<curve referenced from the Rhino model> x8])
pt = Point([<point referenced from the Rhino model> x4])
forcediagram = ForceDiagram(ListSurface1=srf, ListSurface2=srf_2, FixedBoundary=crv, FixedPoints=pt)
